# Dynamo graph demo.dyn (Dynamo 2.16.4.10216)

code_block = CodeBlock { 1; 2; 3; }
byCoordinates = Point.ByCoordinates(x=code_block.out0, y=code_block.out1, z=code_block.out2)
demo_python_node = Python(IN[0]=byCoordinates)  # CPython3
# ---------- demo_python_node.python (4 lines) ----------
point = IN[0]
point.X = 10.0
print(point)
OUT = point
# ----------------------------------------
